# Requirement set Requirements_Simulink_Model (R2021a)

## 1 [mov] Moving
Only when doors are closed

### 1.1 [movUp] Moves Up
System moves up

### 1.2 [MovDown] Moves Down
System moves down

### 1.3 [MovNo] No Movement
System doesn't move if no command is inputted

## 2 [door] Doors

### 2.1 [doorCAuto] Doors Close Auto
System closes doors automatically after (x)seconds of being open

### 2.2 [doorOpAuto] Doors Open Auto
System opens doors automatically for 10 seconds when it reaches the correct floor

### 2.3 [doorCMan] Doors Close Manual
System closes doors when manual close door button is pressed

### 2.4 [doorOpMan] Doors Open Manual
System opens doors when manual open door button is pressed

### 2.5 [DoorNoClose] No Close Object Detection
System doesn't closes doors when the sensor detects object

## 3 [comm] Commands

### 3.1 [commMem] Remembers Commands
System remebers commands (elaborate)

### 3.2 [commOrder] Orders Commands
System orders commands (elaborate)

### 3.3 [commRep] Ignores repetition
System ignores repeated commands

### 3.4 [commExt] External Commands
System recognises external call button and add it to the logic

### 3.5 [commClear] Clear Memory
System clears memory once it has completed the command

### 3.6 [commAdd] Adding Commands
System adds commands as passengers get on

## 4 [em] Emergency
System changes to the emergency state when the emergency button is pressed

## 5 [pass] Passengers

### 5.1 [passW] Weight
System can hold (x)kg

#### 5.1.1 [passWAlert] Alert Excess
System alerts if the max capacity is reached

### 5.2 [passN] Number
System adds passengers as then step into the lift

## 6 [kin] Kinematic

### 6.1 [kinSlow] Slow Down
System slows down as it approaches the requested floor

### 6.2 [kinFast] Speed Up
System speeds up after closing doors

## 7 [but] Buttons

### 7.1 [butEx] External

#### 7.1.1 [butExUp] Up Button

#### 7.1.2 [butExDown] Down Button

### 7.2 [butInt] Internal

#### 7.2.1 [butIntNumb] Number Pad

#### 7.2.2 [butIntOpen] Open Manually

#### 7.2.3 [butIntClose] Close Mannually